vi "index.gviweb"   [LabVIEW NXG 3.1.0]
panel controls:
  "Ordem de serviço": string
  "Ferramenta": string
  "Temperature 1": f64
  "Temperature 2": f64
  "Get Ordem de serviço": bool
  "Get Ferramenta": bool
types:
  T1 = cluster{"SO Barcode": string, "Tool Barcode": string}
uses:
  NI::HTTP::GET.gvi
diagram:
  # Place setup code before the loop. For example, perform initial data communication and wire the results into the loop.
  # Top-Level WebVIs usually contain a While Loop that never stops so that they can continue running as long as the web page is open in the user's web browser.
  while {
    event (timeout = 1000) {
      on "Get Ordem de serviço" Value changed {
        w1 = "http://10.48.0.67:8001/WebService/ServiceOrderBarcode_(Get)"
        call "GET.gvi"(url=w1) -> (body=w2)
        $"Ordem de serviço" <- w2
      }
      on "Get Ferramenta" Value changed {
        call "GET.gvi"(url="http://10.48.0.67:8001/WebService/ToolBarcode_(Get)") -> (body=w3)
        $Ferramenta <- w3
      }
      on Timeout {
        call "GET.gvi"(url="http://10.48.0.67:8001/WebService/PollData(Synch)") -> (body=w4)
        Is Empty String Or Path(string/path=w4) -> w5
        case (w5) {
          frame True { }
          frame False {
            Unflatten From JSON(JSON string=w4, default null elements=TRUE, strict validation=TRUE, type and defaults=T1 {all zero or empty}) -> (value=w6)
            Property Node(instance in=w6) -> ("SO Barcode"=w7, "Tool Barcode"=w8)
            Is Empty String Or Path(string/path=w7) -> w9
            case (w9) {
              frame True { }
              frame False {
                $"Ordem de serviço" <- w7
              }
            }
            Is Empty String Or Path(string/path=w8) -> w10
            case (w10) {
              frame True { }
              frame False {
                $Ferramenta <- w8
              }
            }
          }
        }
      }
    }
    Wait(time to wait=50)
    stop if FALSE
  }
